# Grasshopper definition tower gh.gh (Grasshopper 1.0.8)

pt = Point(<point referenced from the Rhino model>)
pt_2 = Point(<point referenced from the Rhino model>)
angle = Slider(0, range=0..360)
G = Geometry(<extrusion referenced from the Rhino model>)
ln = Line(StartPoint=pt_2, EndPoint=pt)
twist = Twist(Geometry=G, Axis=ln, Angle=degrees(angle), Infinite=False, Rigid=False)
preview = CustomPreview(
    Geometry=twist,
    Material={diffuse=RGB(221, 160, 221), emission=RGB(66, 48, 66), shine=0.5, specular=RGB(255, 255, 255), transparency=0})
